# Grasshopper definition NSGA-II (1).gh (Grasshopper 1.0.7)

timer = Timer(TimerInterval=10, Target=python)  # disabled
# Multi-Objective GA - NSGA II
toggle = BooleanToggle(True)
python = GhPythonScript(Toggle=toggle, Reset=Button())  # -> out, a, b, c, x, y, d, pareto
# ---------- python: Python ----------
__author__ = "Mahdi Jandaghimeibodi"
__version__ = "2020.03.06"


import random as r
from copy import deepcopy
import scriptcontext as sc
import inspect
import math as m

class DNA:
    
    geneMin = 0  # lower bound of var.
    geneMax = 2   # upper bound of var.
    nGenes = 10   # number of var
    
    def __init__(self,dna=None):
        
        if dna==None:
            self.Genome=[ r.uniform(self.geneMin,self.geneMax) for i in range(self.nGenes)]
        else: 
            self.Genome=dna
        
        self.fitnessVec=[]
        
        self.domination_count=0                            #number Dnas dominating this dna
        self.dominates=[]                                  #list to store indecis of Dnas this dna dominates
        self.rank=float('inf')
        
        self.crowding_distance=0                           #crowding_distance values
               

class Population:
    
    def __init__(self,costFunctions,populationSize):
        
        self.costFunctions = costFunctions
        self.dim= len(self.costFunctions)
        
        self.populationSize= populationSize
        self.population = [DNA() for _ in range(populationSize)]       #Creating the initial population
        self.evalFitness(self.population)                              #Evaluating their fitness
        self.fronts,_= self.non_dominated_sorting()                    #Categorizing them into fronts
        
        self.calculate_crowding()                                      #Calculating their crowding score

        self.pareto=None
        
        pCrossover = 0.7                                               #Cross over percentage
        self.nCrossover = round(pCrossover * populationSize / 2) * 2   #rounding so we get an integer number of population mating (produces even number)

        pMutation = 0.2                                                #Mutation percentage
        self.nMutation = round(pMutation * populationSize)             #rounding so we get an integer number of population mutating
        
        self.matingPool=[]
        
    def evalFitness(self, population):
        for dna in population:                                         #Calculating the fitness vector
            for func in self.costFunctions:
                dna.fitnessVec.append(func(dna.Genome))
                
    def non_dominated_sorting(self):
        
        #checking dominations
        for i in range(len(self.population)):                                                            #Cross Checking
            for j in range(i+1, len(self.population)):
                
                bool1=1
                bool2=0                
                
                bool3=1
                bool4=0 
                
                
                for k in range(self.dim):         #check every fitness objective  #this part has been modified to work with dynamic number of fitness objectives
                    
                    bool1 &= self.population[i].fitnessVec[k]<=self.population[j].fitnessVec[k]
                    bool2 |= self.population[i].fitnessVec[k]<self.population[j].fitnessVec[k]
                    
                    bool3 &= self.population[j].fitnessVec[k]<=self.population[i].fitnessVec[k]
                    bool4 |= self.population[j].fitnessVec[k]<self.population[i].fitnessVec[k]
                    
                if bool1 and bool2:    
                    self.population[i].dominates.append(j)
                    self.population[j].domination_count+=1
                
                elif bool3 and bool4:
                    self.population[j].dominates.append(i)
                    self.population[i].domination_count+=1
        
        #pick front
        fronts=[]                                              #list to store all fronts
        frontsIndecis=[]                                       #list to store indecis of DNAs added to the fronts list
        while len(frontsIndecis) < self.populationSize :
            front=[]
            frontsIdx=[]                                       #list to store index of DNAs added to the current front 
            for i in range(len(self.population)):                                
                                  
                if self.population[i].domination_count==0 and (i not in frontsIndecis) : #if the DNA rank is 0 and it has not been added to any front:                
                    
                    front.append(self.population[i])                                    #adding the DNA to the front 
                    frontsIdx.append(i)                                                 #adding the vector index to frontsIdx
                    self.population[i].rank = len(fronts)                               #which front does this dna belong to (rank)
                          
            for num in frontsIdx: 
                for index in self.population[num].dominates:
                    self.population[index].domination_count-=1                          #subtracting  domination_count of elements it dominates by one
                self.population[num].dominates=[]                                       #reseting the Dna setting for the nesxt loop
            fronts.append(front)
            frontsIndecis+=frontsIdx                                                    #a front has been made, incrementing frontcount by 1
        
        redundancies = len(frontsIndecis) - self.populationSize                         #number of extra DNAs in the last front 
        return fronts, redundancies
        
    def calculate_crowding(self):
        for front in self.fronts:                                              #for every front
            for i in range(self.dim):                                          #for every dimension (fitness objective)  Total Crowding Distance= sum of Crowding Distance of all fitness objective
                sorted_front=sorted(front, key=lambda t: t.fitnessVec[i])      #sort front based on  fitness value 
                
                sorted_front[0].crowding_distance=1                     #we will keep the first and the last item of the front for the next generation by setting their score to 1 (maximum score)                                                          
                if len(sorted_front)>0:                                 #Conditional, in case the last front has only 1 item                                             
                    sorted_front[len(front)-1].crowding_distance=1          
                    
                    diff= sorted_front[len(front)-1].fitnessVec[i] - sorted_front[0].fitnessVec[i]       #(max-min) this will be used for normalization
                    
                    for j in range(1,len(front)-1):                                                       #we will iterate over all items execpt first and last
                        sorted_front[j].crowding_distance+= (sorted_front[j+1].fitnessVec[i] - sorted_front[j-1].fitnessVec[i]) / diff  #calculating normalized crowding distance
    
    def create_matingPool_1(self):
        #ordinals of scoring Selection
        self.matingPool=[]
        
        self.population= sorted(self.population ,key=lambda t:t.fitness, reverse=False)
        
        for p in self.population:
            n= len(self.population) - self.population.index(p)
            for i in range(n):
                self.matingPool.append(p)
                
    def create_matingPool_2(self):
        self.matingPool= self.population[:]
        r.shuffle(self.matingPool)
                          
    def tournoment_selection(self):
        
        parents=[]
        idx=r.sample(range(len(self.matingPool)), k=4)
        
        for i in range(2):
        
            dna1= self.matingPool[idx[i]]
            dna2= self.matingPool[idx[i+2]]
            
            if dna1.rank < dna2.rank:
                parents.append(dna1)
            if dna1.rank > dna2.rank:
                parents.append(dna2)
            
            if dna1.rank == dna2.rank :
                if dna1.crowding_distance < dna2.crowding_distance:
                    parents.append(dna2)
                elif dna1.crowding_distance > dna2.crowding_distance:
                    parents.append(dna1)
                else:
                    parents.append(dna2)                                #incase both crowding_distances were equal
        
        #removing the parents from mating pool will increase diversity when picking parents in next loop
        self.matingPool.remove(parents[0])
        self.matingPool.remove(parents[1])
        
        return parents

    def reproduce(self):
        
        self.create_matingPool_2()                                              #creating the mating pool
        
        children=[]                                                             
        for _ in range(int(self.nCrossover/2)):
            parents= self.tournoment_selection()
            newGenomes= self.crossOver(parents)
            children+=[DNA(Genome) for Genome in newGenomes]
        
        observers=[]
        for _ in range(int(self.nMutation)):
            Genome1 = r.choice(self.population).Genome[:]                       #copy the genome                                               
            observers+= [DNA(self.mutate(Genome1))]                             #mutate it #save it in observers list
            
            
        self.evalFitness(children + observers)                                  #calc fitness vectors of newly created DNAs
        
        self.population += children + observers                                 #merge populations
        self.fronts, extra = self.non_dominated_sorting()                       #create fronts
        self.calculate_crowding()
        
        lastfront=self.fronts[len(self.fronts)-1][:]                                    #copy last front
        lastfront= sorted(lastfront ,key=lambda t:t.crowding_distance, reverse=True)    #sort last front based on crowding_distance
        self.fronts[len(self.fronts)-1]= lastfront[:len(lastfront)-extra]               #remove extra Dnas from  last front and update fronts
        
        self.pareto=self.fronts[0]                                                      #update best front
        print len(self.fronts)
        print len(self.fronts[0])
        self.population=[ dna for front in self.fronts for dna in front]               #updating population (this is an important step since mating pool in next loop will be created from self.population)
        
    def crossOver(self,parents): 
        #this is blend crossOver, check audio for genetic algorithm  G'= y*G1 + (1-y)*G2)) & G'= y*G2 + (1-y)*G1) 
        alpha = 0.5
        y = [r.uniform(-alpha,1+alpha) for _ in parents[0].Genome]
        
        newGenome1 = []
        newGenome2 = []
        
        for i,j,k in zip(parents[0].Genome,parents[1].Genome,y):
            t = k*i + (1-k)*j
            u = k*j + (1-k)*i
            
            newGenome1.append(min(max(t, DNA.geneMin), DNA.geneMax))
            newGenome2.append(min(max(u, DNA.geneMin), DNA.geneMax))
        
        return [newGenome1,newGenome2]
        
    def mutate(self,Genome): 
        #this is gussian mutation. check audio for genetic algorithm
        i = r.choice(range(len(Genome))) 
        sigma = (DNA.geneMax - DNA.geneMin) * 0.1
        Genome[i]= min(max(Genome[i] + sigma * r.gauss(0,1), DNA.geneMin), DNA.geneMax)
        return  Genome

def costFunction(x):  
    Squared=[i**2 for i in x]
    z = sum(Squared)
    return z

def costFunction2(x):
    Squared=[m.sin(i) for i in x]
    z = sum(Squared)
    diff= m.cos(z)*10
    return abs(diff)
    
def costFunction3(x):
    Squared=[m.sin(i) for i in x]
    z = sum(Squared)
    return abs(z)    

objs=dir()
costFunctions= [ eval(a) for a in objs if (inspect.isfunction(eval(a))== True) and (a.startswith("costFunction"))]       #creating the function list


#mainLoop
populationSize = 50

#mainLoop
if "myPopulation1" not in sc.sticky:
    sc.sticky["myPopulation1"]= Population(costFunctions, populationSize)
    
if Toggle:
    #sc.sticky["myPopulation1"].select()
    sc.sticky["myPopulation1"].reproduce()
    
if Reset:
    sc.sticky["myPopulation1"]= Population(costFunctions, populationSize)  
    print sc.sticky["myPopulation1"].fronts[0][0].fitnessVec
    
    

x= [dna.fitnessVec[0] for front in sc.sticky["myPopulation1"].fronts for dna in front]
y= [dna.fitnessVec[1] for front in sc.sticky["myPopulation1"].fronts for dna in front]
d= [dna.fitnessVec[2] for front in sc.sticky["myPopulation1"].fronts for dna in front]

pareto= sc.sticky["myPopulation1"].pareto


#if sc.sticky["myPopulation1"].pareto!= None:
a= [dna.fitnessVec[0] for dna in sc.sticky["myPopulation1"].fronts[0]]
b= [dna.fitnessVec[1] for dna in sc.sticky["myPopulation1"].fronts[0]]
c= [dna.fitnessVec[2] for dna in sc.sticky["myPopulation1"].fronts[0]]
# ---------- end python ----------
pt = ConstructPoint(XCoordinate=python.a, YCoordinate=python.b, ZCoordinate=python.c)
panel = Panel(python.pareto)
pt_2 = ConstructPoint(XCoordinate=python.x, YCoordinate=python.y, ZCoordinate=python.d)
panel_2 = Panel(pt)
